# Grasshopper definition 20_Check_Ceiling_Room.gh (Grasshopper 1.0.8)
# plug-ins: Pufferfish, Rhino.Inside for Autodesk Revit, MetaHopper, Wombat

doubleclick = BooleanToggle(False)
dss_annotation_panel = Panel("Help on WhiteWork")
# Segment
# group modules into larger coherent parts
# User Interface: I/O
dss_log_v5_2 = PythonScript(Help=doubleclick)  # inputs Help: Boolean
# ---------- dss_log_v5_2: Python ----------
"""
Set grasshopper template and provide easy acces to Help file in intranet

"""

"""
Credits:
    20211117
    Created by Vladimir Ondejcik
    White arkitekter AB

Based on:
    WOMBAT version <0.0.1>
    Script by <Brian Ringley>
        def libraries() by <Giulio Piacentino> see <http://www.grasshopper3d.com/forum/topics/gh-filename-is-python>
        def writeToFile() by <Data Analytics Society> see <https://www.youtube.com/watch?v=-TF3mXhnCDw>
    Script version <15 September 2015> 
    Copyright <Creative Commons Sharealike>
"""


#add dsearch default path located on cad.local
import sys
new_path = r"\\sesthfs02\DSEARCH\REPOSITORY\Grasshopper\Xtras\DsearchCode"
if new_path not in sys.path: sys.path.append(new_path)

#import dsearch plugin
import dsearch as ds

import os

print sys.path

#reload module (this has use when working on module)
#reload(ds.DS_Log)
#reload(ds.DS_Links)

#setup template
template=ds.DS_Links.Template
ds.DS_Log.DS_Template(template)

#run help from module 
if Help:
    helpLink=ds.DS_Links.HelpLink
    ds.DS_Log.DS_Help(helpLink)

    #turn toggle back to false
    obj=ghenv.Component.Params.Input[0].Sources[0]
    obj.Value=False
    obj.ExpireSolution(True)
# ---------- end dss_log_v5_2 ----------

dss_projectnumber = Panel("0000")
dss_projectname = Panel("name")

# ----
# Organization of Grasshopper scripts at White:
# Script should be created and annotated always with notion that other person will need to use/edit them.
# Build your script in modules and segments, use color coding and annotation according this template.
# This standard should be applied to all scripts, big or small.
# 
# Read  guide on white work:
# "https://work.white.se/grasshopper-developer-guide/"
# For Advanced users:
# For design scripts running more than a month use "dsInitialize" and "dsScriptLog" functions on Dsearch tab to log changes over time.
dss_annotation_panel_2 = Panel("""Tip of a day:
You can change default colour grups by right clicking
Graphical templates are located on "Dsearch" tab""")
# GRAPHIC
# STANDARD
# In
# data and geometry import from rhino or external platforms
image = ImageSampler(dss_annotation_panel_2, Filter="Colour", Interpolate=False, Umax=1, Umin=0, Vmax=1, Vmin=0, Wrap=0)

# ---- group: Line Type
categories = QueryCategories(Type=1, Name="Lines", IsVisibleUI=True, IsSubcategory=False)
subcat = AddSubCategory(Parent=categories, Name="Ceiling_Control_RiR", FailureProcessingMode=1)
catstyle = CategoryStyle(Category=subcat, LineWeight_projection="10", LineColor=ColourSwatch(SwatchColor=RGB(255, 0, 34)))  # -> Category, LineWeight_projection, LineWeight_cut, LineColor, LinePattern_projection, Material

# ---- group: Controls for testing/development
a_view = ActiveView()
onoff = EnableDisableObject(Enabled=Toggle(True), AllObjects_Object=d_line)
onoff_2 = EnableDisableObject(Enabled=Toggle(True), AllObjects_Object=[categories_2, panel, a_view])

# ----
# Control
# General
# Monitor
# variable parameters and script execution
# (sliders, boolean togggle, text input,...)
# monitor data and geometry preview (used for panels for example)
# WIP
# Annotation
# Plugin
# general annotation and notes
# textbased scripting and special plugins
# f.ex: HumanUI, kangaroo,...
dss_annotation_panel_3 = Panel("general development modules")

view = View(a_view)
line_style = LineStyle(catstyle.Category)

# ---- group: Room Outlines
L = Levels(a_view)
rooms = QueryRooms(Placed=True, Level=L, Enclosed=True)
lng = ListLength(List=L)
smaller = SmallerThan(FirstNumber=lng, SecondNumber=Slider(2, range=0..10))  # -> SmallerThan, OrEqualTo
pln = Plane(simplify(graft(L)))

# ----
levelfltr = LevelFilter(Levels=L, Inverted=False)

# ---- group: Ceiling Outlines
panel = Panel("Ceilings")
categories_2 = QueryCategories(Type=1, Name=panel, IsVisibleUI=True, IsSubcategory=False)
types = QueryTypes(Kind=3, Category=categories_2)
catfltr = CategoryFilter(Categories=categories_2, Inverted=False)
cset = CreateSet(List=types)  # -> Set, Map
typefltr = TypeFilter(Types=cset.Set, Inverted=False)
andfltr = LogicalAndFilter(FilterA=levelfltr, FilterB=catfltr, FilterC=typefltr)
elements = QueryElements(Filter=andfltr, Limit=300)  # -> Elements, Count
graphical_element = GraphicalElement(elements.Elements)
geometry = ElementGeometry(Elements=graphical_element)  # -> simplify(Geometry)

# ---- group: Extracting room Base
# Creates Lines where Ceilings deviates from room outlines
brep = Brep(rooms)
# problematic or under repair or construction
debrep = DeconstructBrep(Brep=brep)  # -> simplify(Faces), Edges, Vertices
md_slider = MDSlider(SliderMode=0, slider_value=Point(0.5, 0.5, 0.5), x_domain=Domain(0, 1), y_domain=Domain(0, 1), z_domain=Domain(0, 1))
# Out
# output data to rhino or external platforms
evalsrf = EvaluateSurface(Surface=debrep.Faces, Point=md_slider)  # -> Point, unitize(Normal), UDirection, VDirection, Frame
Z = UnitZ(Factor=1)
dprod = DotProduct(VectorA=evalsrf.Normal, VectorB=Z, Unitize=False)
cull = CullPattern(List=debrep.Faces, CullPattern=dprod)
area = Area(Geometry=cull)  # -> Area, Centroid
pdecon = Deconstruct(Point=area.Centroid)  # -> XComponent, YComponent, ZComponent
sort = SortList(Keys=pdecon.ZComponent, ValuesA=cull)  # -> Keys, ValuesA
item = ListItem(List=sort.Keys, Index=0, Wrap=True)  # -> Item1, Item
mindex = MemberIndex(Set=sort.Keys, Member=item.Item)  # -> Index, Count
item_2 = ListItem(List=sort.ValuesA, Index=mindex.Index, Wrap=True)
debrep_2 = DeconstructBrep(Brep=item_2)  # -> simplify(Faces), simplify(Edges), Vertices
join = JoinCurves(Curves=debrep_2.Edges, Preserve=False)

# ---- group: Room Outlines (continued)
close = CloseCurve(Curve=flatten(join), Tolerance=0)  # -> simplify(flatten(ClosedCurve))
simplify = SimplifyCurve(Curve=close)  # -> Curve, Simplified
runion = RegionUnion(Curves=simplify.Curve, Plane=pln)  # -> simplify(Result)
tree_to_main_index = TreeToMainIndex(T=runion)
filter = StreamFilter(Gate=smaller.SmallerThan, Stream0=tree_to_main_index, Stream1=flatten(runion))
crv = Curve(filter)
project = Project(Geometry=crv, Plane=pln)  # -> Geometry, Transform
simplify_2 = SimplifyCurve(Curve=project.Geometry)  # -> Curve, Simplified
runion_2 = RegionUnion(Curves=simplify_2.Curve, Plane=simplify(graft(pln)))

# ---- group: Ceiling Outlines
debrep_3 = DeconstructBrep(Brep=geometry)  # -> Faces, simplify(Edges), Vertices
Z_2 = UnitZ(Factor=1)
dprod_2 = DotProduct(VectorA=debrep_3.Edges, VectorB=Z_2, Unitize=False)
cull_2 = CullPattern(List=debrep_3.Edges, CullPattern=invert(dprod_2))
join_2 = JoinCurves(Curves=cull_2, Preserve=False)  # -> simplify(flatten(Curves))
runion_3 = RegionUnion(Curves=join_2, Plane=simplify(graft(pln)))
runion_4 = RegionUnion(Curves=runion_3, Plane=simplify(graft(pln)))

# ---- group: Union
project_2 = Project(Geometry=runion_4, Plane=pln)  # -> Geometry, Transform
rdiff = RegionDifference(CurvesA=simplify(graft(project_2.Geometry)), CurvesB=runion_2, Plane=simplify(graft(pln)))  # -> simplify(Result)

# ----
rdiff_2 = RegionDifference(CurvesA=simplify(graft(runion_2)), CurvesB=project_2.Geometry, Plane=simplify(graft(pln)))  # -> simplify(Result)

# ---- group: Remove room curves without ceiling
area_2 = Area(Geometry=rdiff_2)  # -> simplify(Area), Centroid
area_3 = Area(Geometry=runion_2)  # -> simplify(Area), Centroid
roundd = RoundToDecimalPlace(NumberX=area_2.Area, DecimalPlace=Slider(2, range=0..10), RoundType=0)  # -> Rounded, Difference
roundd_2 = RoundToDecimalPlace(NumberX=area_3.Area, DecimalPlace=Slider(2, range=0..10), RoundType=0)  # -> Rounded, Difference
equals = Equality(FirstNumber=graft(roundd.Rounded), SecondNumber=roundd_2.Rounded)  # -> simplify(Equality), Inequality
ma = MassAddition(Input=equals.Equality)  # -> Result, PartialResults
cull_3 = CullPattern(List=graft(rdiff_2), CullPattern=invert(ma.Result))

# ---- group: Union (continued)
crv_2 = Curve(flatten([rdiff, cull_3]))

# ---- group: Move lines (maybe redundant)
v_range = ViewRange(View=a_view)  # -> View, PrimaryRangeTop, PrimaryRangeCutPlane, PrimaryRangeBottom, ViewDepthLevel
level = Level(a_view)
identity = LevelIdentity(Level=level)  # -> Name, Elevation, Structural, BuildingStory
num = Number(v_range.PrimaryRangeBottom)
num_2 = Number(identity.Elevation)
subtraction = Subtraction(A=num, B=num_2)
Z_3 = UnitZ(Factor=subtraction)
move = Move(Geometry=crv_2, Motion=Z_3)  # -> Geometry, Transform

# ---- group: Area Check
clean = CleanTree(RemoveNulls=True, RemoveInvalid=True, RemoveEmpty=False, Tree=crv_2)  # -> flatten(Tree)
area_4 = Area(Geometry=clean)  # -> Area, Centroid
ma_2 = MassAddition(Input=area_4.Area)  # -> Result, PartialResults
_10º = PowerOf10(Value=Slider(6, range=0..10))
division = Division(A=ma_2.Result, B=_10º)
panel_2 = Panel(division)

# ---- group: Write Lines to active view
explode = Explode(Curve=move.Geometry, Recursive=True)  # -> flatten(Segments), Vertices
d_line = AddDetailLine(View=view, Curve=explode.Segments)
linestyle = CurveLineStyle(Element=d_line, LineStyle=line_style)  # -> Element, LineStyle
pinelem = PinElement(Element=d_line, Pinned=Toggle(False))  # -> Element, Pinned

# ==== cluster TreeToMainIndex
T = ClusterInput()

# ---- group: Tree to main index
clean = CleanTree(RemoveNulls=True, RemoveInvalid=True, RemoveEmpty=True, Tree=T)
tstat = TreeStatistics(Tree=clean)  # -> Paths, Length, Count
split = TextSplit(Text=tstat.Paths, Separators=";")  # -> simplify(Result)
item = ListItem(List=split, Index=0, Wrap=True)
concat = Concatenate(FragmentA=item, FragmentB="}")
rep = ReplaceText(Text=concat, Find="}}", Replace="}", RecursiveReplace=False)
dup = DuplicateData(Data=rep, Number=simplify(graft(tstat.Length)), Order=True)  # -> flatten(Data)

# ----
data = Data(clean)

# ---- group: Tree to main index (continued)
tree = CreateTree(Data=data, Path=dup)

# ----
D = ClusterOutput(tree)
