# Grasshopper definition 24_Center SG_Grid_V.gh (Grasshopper 1.0.8)
# plug-ins: Pufferfish, Rhino.Inside for Autodesk Revit

active_selection = GraphicalElement()
gate = StreamGate(Stream=active_selection, Gate=Toggle(False))  # -> Target0, Target1
active_selection_2 = GraphicalElement(gate.Target0)
active_selection_3 = GraphicalElement(gate.Target1)
hostgrids = HostCurtainGrids(Host=active_selection_2)
deconstruct_curtain_grid = DeconstructCurtainGrid(CurtainGrid=hostgrids)  # -> Cells, Mullions, Panels, VerticalLines, VerticalAngle, VerticalJustification, VerticalOffset, HorizontalLines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
boundprof = HostBoundaryProfile(Host=active_selection_2)  # -> Plane, Profile
hostgrids_2 = HostCurtainGrids(Host=active_selection_3)
explode = Explode(Curve=boundprof.Profile, Recursive=True)  # -> Segments, Vertices
line = Line(deconstruct_curtain_grid.VerticalLines)
line_2 = Line(deconstruct_curtain_grid.HorizontalLines)
deconstruct_curtain_grid_2 = DeconstructCurtainGrid(CurtainGrid=hostgrids_2)  # -> Cells, Mullions, Panels, VerticalLines, VerticalAngle, VerticalJustification, VerticalOffset, HorizontalLines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
boundprof_2 = HostBoundaryProfile(Host=active_selection_3)  # -> Plane, Profile
vec = Vector(unitize(line_2))
vec_2 = Vector(unitize(line))
explode_2 = Explode(Curve=boundprof_2.Profile, Recursive=True)  # -> Segments, Vertices
cset = CreateSet(List=vec)  # -> Set, Map
vec_3 = Vector(unitize(explode.Segments))
line_3 = Line(deconstruct_curtain_grid_2.HorizontalLines)
cset_2 = CreateSet(List=vec_2)  # -> Set, Map
dprod = DotProduct(VectorA=cset_2.Set, VectorB=vec_3, Unitize=False)
vec_4 = Vector(unitize(line_3))
cset_3 = CreateSet(List=vec_4)  # -> Set, Map
vec_5 = Vector(unitize(explode_2.Segments))
project = Project(Geometry=line, Plane=boundprof.Plane)  # -> Geometry, Transform
cull = CullPattern(List=explode.Segments, CullPattern=dprod)
len = Length(Curve=cull)
dprod_2 = DotProduct(VectorA=cset_3.Set, VectorB=vec_5, Unitize=False)
sort = SortList(Keys=len, ValuesA=cull)  # -> Keys, ValuesA
project_2 = Project(Geometry=line_3, Plane=boundprof_2.Plane)  # -> Geometry, Transform
cull_2 = CullPattern(List=explode_2.Segments, CullPattern=dprod_2)
len_2 = Length(Curve=cull_2)
item = ListItem(List=sort.ValuesA, Index=0, Wrap=True)  # -> Item, Item1
sort_2 = SortList(Keys=len_2, ValuesA=cull_2)  # -> Keys, ValuesA
midpt = CurveMiddle(Curve=reparameterize(item.Item))
item_2 = ListItem(List=sort_2.ValuesA, Index=0, Wrap=True)  # -> Item, Item1
crv_cp = CurveClosestPoint(Point=midpt, Curve=item.Item1)  # -> Point, Parameter, Distance
midpt_2 = CurveMiddle(Curve=reparameterize(item_2.Item))
pt = Point(crv_cp.Point)
parameters = QueryElementParameters(Element=active_selection_2)
twn2pts = TweenTwoPoints(PointA=midpt, PointB=pt, Factor=0.5)
crv_cp_2 = CurveClosestPoint(Point=midpt_2, Curve=item_2.Item1)  # -> Point, Parameter, Distance
tmatch = MatchText(Text=parameters, RegEx="Offset", Case=True)
pt_2 = Point(crv_cp_2.Point)
parameters_2 = QueryElementParameters(Element=active_selection_3)
cull_3 = CullPattern(List=parameters, CullPattern=tmatch)
twn2pts_2 = TweenTwoPoints(PointA=midpt_2, PointB=pt_2, Factor=0.5)
panel = Panel("Grid 1:Offset")
identity = ParameterIdentity(Parameter=cull_3)  # -> Guid, Name, Type, Group
value_picker = ValuePicker(identity.Group)
tmatch_2 = MatchText(Text=parameters_2, RegEx="Offset", Case=True)
cull_4 = CullPattern(List=parameters_2, CullPattern=tmatch_2)
tmatch_3 = MatchText(Text=identity.Group, RegEx=value_picker, Case=True)
crv_cp_3 = CurveClosestPoint(Point=twn2pts, Curve=project.Geometry)  # -> Point, Parameter, Distance
identity_2 = ParameterIdentity(Parameter=cull_4)  # -> Guid, Name, Type, Group
value_picker_2 = ValuePicker(identity_2.Group)
cull_5 = CullPattern(List=cull_3, CullPattern=tmatch_3)
sort_3 = SortList(Keys=crv_cp_3.Distance, ValuesA=project.Geometry)  # -> Keys, ValuesA
tmatch_4 = MatchText(Text=identity_2.Group, RegEx=value_picker_2, Case=True)
crv_cp_4 = CurveClosestPoint(Point=twn2pts_2, Curve=project_2.Geometry)  # -> Point, Parameter, Distance
item_3 = ListItem(List=sort_3.Keys, Index=0, Wrap=True)  # -> Item, Item1
cull_6 = CullPattern(List=cull_4, CullPattern=tmatch_4)
sort_4 = SortList(Keys=crv_cp_4.Distance, ValuesA=project_2.Geometry)  # -> Keys, ValuesA
addition = Addition(A=item_3.Item, B=item_3.Item1)
item_4 = ListItem(List=sort_4.Keys, Index=0, Wrap=True)  # -> Item, Item1
division = Division(A=addition, B="2")
addition_2 = Addition(A=item_4.Item, B=item_4.Item1)
subtraction = Subtraction(A=division, B=item_3.Item1)
division_2 = Division(A=addition_2, B="2")
subtraction_2 = Subtraction(A=division_2, B=item_4.Item1)
param = ElementParameter(Element=active_selection_2, Parameter=cull_5, Value=subtraction)  # -> Element, Value
param_2 = ElementParameter(Element=active_selection_3, Parameter=cull_6, Value=subtraction_2)  # -> Element, Value
