# Grasshopper definition XX_Ceiling_Sketch_Rooms.gh (Grasshopper 1.0.8)
# plug-ins: Rhino.Inside for Autodesk Revit

doubleclick = BooleanToggle(False)
dss_annotation_panel = Panel("Help on WhiteWork")
# Segment
# group modules into larger coherent parts
# User Interface: I/O
dss_log_v5_2 = PythonScript(Help=doubleclick)  # inputs Help: Boolean
# ---------- dss_log_v5_2: Python ----------
"""
Set grasshopper template and provide easy acces to Help file in intranet

"""

"""
Credits:
    20211117
    Created by Vladimir Ondejcik
    White arkitekter AB

Based on:
    WOMBAT version <0.0.1>
    Script by <Brian Ringley>
        def libraries() by <Giulio Piacentino> see <http://www.grasshopper3d.com/forum/topics/gh-filename-is-python>
        def writeToFile() by <Data Analytics Society> see <https://www.youtube.com/watch?v=-TF3mXhnCDw>
    Script version <15 September 2015> 
    Copyright <Creative Commons Sharealike>
"""


#add dsearch default path located on cad.local
import sys
new_path = r"\\sesthfs02\DSEARCH\REPOSITORY\Grasshopper\Xtras\DsearchCode"
if new_path not in sys.path: sys.path.append(new_path)

#import dsearch plugin
import dsearch as ds

import os

print sys.path

#reload module (this has use when working on module)
#reload(ds.DS_Log)
#reload(ds.DS_Links)

#setup template
template=ds.DS_Links.Template
ds.DS_Log.DS_Template(template)

#run help from module 
if Help:
    helpLink=ds.DS_Links.HelpLink
    ds.DS_Log.DS_Help(helpLink)

    #turn toggle back to false
    obj=ghenv.Component.Params.Input[0].Sources[0]
    obj.Value=False
    obj.ExpireSolution(True)
# ---------- end dss_log_v5_2 ----------

dss_projectnumber = Panel("0000")
dss_projectname = Panel("name")

# ----
# Organization of Grasshopper scripts at White:
# Script should be created and annotated always with notion that other person will need to use/edit them.
# Build your script in modules and segments, use color coding and annotation according this template.
# This standard should be applied to all scripts, big or small.
# 
# Read  guide on white work:
# "https://work.white.se/grasshopper-developer-guide/"
# For Advanced users:
# For design scripts running more than a month use "dsInitialize" and "dsScriptLog" functions on Dsearch tab to log changes over time.
dss_annotation_panel_2 = Panel("""Tip of a day:
You can change default colour grups by right clicking
Graphical templates are located on "Dsearch" tab""")
# GRAPHIC
# STANDARD
# In
# data and geometry import from rhino or external platforms
image = ImageSampler(dss_annotation_panel_2, Filter="Colour", Interpolate=False, Umax=1, Umin=0, Vmax=1, Vmin=0, Wrap=0)

active_selection = Ceiling()
selelems = SelectElement(Element=active_selection, Selected=Toggle(True))  # -> Element, Selected

# ----
# Control
# General
# Monitor
# Out
# variable parameters and script execution
# (sliders, boolean togggle, text input,...)
# monitor data and geometry preview (used for panels for example)
# output data to rhino or external platforms
# WIP
# Annotation
# Plugin
# general annotation and notes
# textbased scripting and special plugins
# f.ex: HumanUI, kangaroo,...
# problematic or under repair or construction
dss_annotation_panel_3 = Panel("general development modules")

geometry = ElementGeometry(Elements=active_selection)  # -> simplify(Geometry)
# Back-end
debrep = DeconstructBrep(Brep=geometry)  # -> Faces, simplify(Edges), Vertices
Z = UnitZ(Factor=1)
Z_2 = UnitZ(Factor=1)
dprod = DotProduct(VectorA=debrep.Edges, VectorB=Z, Unitize=False)
cull = CullPattern(List=debrep.Edges, CullPattern=invert(dprod))
join = JoinCurves(Curves=cull, Preserve=False)  # -> simplify(Curves)
item = ListItem(List=join, Index=0, Wrap=True)
ceiling = Ceiling(active_selection)

# ---- group: Find room with most intersaction with ceiling
categories = QueryCategories(Type=1, Name="Rooms", IsVisibleUI=True, IsSubcategory=False)
level = Level(active_selection)
catfltr = CategoryFilter(Categories=categories, Inverted=False)
levelfltr = LevelFilter(Levels=level, Inverted=False)
andfltr = LogicalAndFilter(FilterA=catfltr, FilterB=levelfltr)
elements = QueryElements(Filter=andfltr)  # -> Elements, Count
item_2 = ListItem(List=level, Index=0, Wrap=True)
pln = Plane(item_2)

# ----
geometry_2 = ElementGeometry(Elements=elements.Elements)  # -> simplify(Geometry)
debrep_2 = DeconstructBrep(Brep=geometry_2)  # -> Faces, simplify(Edges), Vertices
dprod_2 = DotProduct(VectorA=debrep_2.Edges, VectorB=Z_2, Unitize=False)
cull_2 = CullPattern(List=debrep_2.Edges, CullPattern=invert(dprod_2))
join_2 = JoinCurves(Curves=cull_2, Preserve=False)  # -> simplify(Curves)
item_3 = ListItem(List=join_2, Index=0, Wrap=True)
panel = Panel(item_3)
cls = Closed(Curve=item_3)  # -> Closed, Periodic
cull_3 = CullPattern(List=item_3, CullPattern=cls.Closed)
clean = CleanTree(RemoveNulls=True, RemoveInvalid=True, RemoveEmpty=True, Tree=cull_3, SynchronousTree1=simplify(graft(elements.Elements)))  # -> Tree, SynchronousTree1
crv = Curve(clean.Tree)
project = Project(Geometry=item, Plane=pln)  # -> Geometry, Transform
project_2 = Project(Geometry=crv, Plane=pln)  # -> Geometry, Transform
area = Area(Geometry=project.Geometry)  # -> Area, Centroid
incurve = PointInCurve(Point=area.Centroid, Curve=flatten(project_2.Geometry))  # -> Relationship, Point
panel_2 = Panel(incurve.Relationship)
bool = Boolean(incurve.Relationship)
cull_4 = CullPattern(List=simplify(flatten(clean.Tree)), CullPattern=bool)

# ---- group: Find room with most intersaction with ceiling (continued)
cluster = Cluster(data=cull_4)
simplify = SimplifyCurve(Curve=flatten(cluster))  # -> simplify(Curve), Simplified

# ----
match_ceiling_sketch_with_room = Python3Script(polyline=simplify.Curve, ceiling=ceiling, run=Toggle(True))  # -> out, result; inputs polyline: list of Curve, ceiling: list, run: Boolean
# ---------- match_ceiling_sketch_with_room: Python ----------
"""
Update Revit Ceiling Footprint from Rhino Polyline
For use in Grasshopper Python component (Rhino.Inside.Revit)

Based on: https://www.modelical.com/en/edit-ceilings-with-revit-api/
Verified for Revit 2024 API (no native ceiling sketch editing yet)

IMPORTANT LIMITATION:
- The new polyline MUST have equal or fewer segments than the existing ceiling
- Cannot add new lines to ceiling sketch (Revit API restriction through 2024)
- If polyline has more segments, simplify it or use a ceiling with more edges
- This workaround modifies the underlying ModelLines of the ceiling sketch

Inputs:
    polyline: Rhino closed polyline curve(s) - single or list (Curve or List[Curve])
    ceiling: Revit ceiling element(s) - single or list (DB.Ceiling or List[DB.Ceiling])
    run: Boolean to trigger execution (bool)

Outputs:
    result: Success/failure message(s) (str or List[str])
"""

import clr
clr.AddReference('RevitAPI')
clr.AddReference('RevitAPIUI')
from Autodesk.Revit.DB import *
from Autodesk.Revit.UI import *

import rhinoscriptsyntax as rs
import Rhino.Geometry as rg
import Rhino
import scriptcontext as sc

# Get the active Revit document (GhPython in RhinoInside.Revit)
clr.AddReference('RhinoInside.Revit')
from RhinoInside.Revit import Revit
doc = Revit.ActiveDBDocument

def rhino_point_to_revit(rhino_point):
    """Convert Rhino Point3d to Revit XYZ with proper unit scaling"""
    # Manual conversion - Revit uses feet, convert from Rhino's unit system
    source_unit = sc.doc.ModelUnitSystem
    
    # Unit system enum values - inverse of the feet-to-x conversion
    unit_scales = {
        0: 1000.0,           # None -> mm (default to mm)
        1: 1.0,              # Microns -> feet / 304800
        2: 1.0/304.8,        # Millimeters -> feet / 304.8
        3: 1.0/30.48,        # Centimeters -> feet / 30.48
        4: 1.0/0.3048,       # Meters -> feet / 0.3048
        5: 1.0/0.0003048,    # Kilometers -> feet / 0.0003048
        6: 1.0/12.0,         # Inches -> feet / 12
        7: 1.0/3.0,          # Mils -> feet / 3000 (actually 12000)
        8: 1.0,              # Feet -> feet / 1
        9: 1.0/0.000189394   # Miles -> feet / (1/5280)
    }
    
    scale = unit_scales.get(int(source_unit), 1.0/304.8)  # Default to mm if unknown
    
    return XYZ(rhino_point.X * scale, 
               rhino_point.Y * scale, 
               rhino_point.Z * scale)

def update_ceiling_footprint(ceiling_element, rhino_curve):
    """
    Update the footprint of a Revit ceiling using a Rhino polyline
    
    Args:
        ceiling_element: Revit ceiling element (DB.Ceiling)
        rhino_curve: Rhino closed polyline curve
    
    Returns:
        str: Result message
    """
    
    if ceiling_element is None:
        return "Error: No ceiling element provided"
    
    if rhino_curve is None:
        return "Error: No polyline provided"
    
    # Check if curve is closed
    if not rhino_curve.IsClosed:
        return "Error: Polyline must be closed"
    
    # Check if the element is actually a ceiling
    if not isinstance(ceiling_element, Ceiling):
        return "Error: Provided element is not a ceiling"
    
    try:
        # Start a transaction
        t = Transaction(doc, "Update Ceiling Footprint")
        t.Start()
        
        # Convert Rhino curve to Revit CurveLoop
        # The curve needs to be converted to Revit's coordinate system
        revit_curves = []
        
        # If it's a polyline, get the segments
        if rhino_curve.IsPolyline():
            polyline_result = rhino_curve.TryGetPolyline()
            if polyline_result[0]:
                polyline = polyline_result[1]
                
                # Convert each segment to Revit Line
                for i in range(polyline.Count - 1):
                    pt1 = polyline[i]
                    pt2 = polyline[i + 1]
                    
                    # Convert Rhino points to Revit XYZ
                    revit_pt1 = rhino_point_to_revit(pt1)
                    revit_pt2 = rhino_point_to_revit(pt2)
                    
                    # Create Revit Line
                    revit_line = Line.CreateBound(revit_pt1, revit_pt2)
                    revit_curves.append(revit_line)
        else:
            # For other curve types, divide curve into line segments
            # Use a small tolerance to approximate the curve
            points = []
            params = rhino_curve.DivideByLength(100, True)  # Divide every 100 units, adjust as needed
            
            if params:
                for param in params:
                    points.append(rhino_curve.PointAt(param))
                # Add start and end points to ensure closure
                points.insert(0, rhino_curve.PointAtStart)
                if not points[-1].DistanceTo(rhino_curve.PointAtEnd) < 0.001:
                    points.append(rhino_curve.PointAtEnd)
            else:
                # Fallback: just use start and end for simple conversion
                points = [rhino_curve.PointAtStart, rhino_curve.PointAtEnd]
            
            for i in range(len(points) - 1):
                pt1 = points[i]
                pt2 = points[i + 1]
                
                revit_pt1 = rhino_point_to_revit(pt1)
                revit_pt2 = rhino_point_to_revit(pt2)
                
                revit_line = Line.CreateBound(revit_pt1, revit_pt2)
                revit_curves.append(revit_line)
        
        if len(revit_curves) == 0:
            t.RollBack()
            return "Error: Could not convert polyline to Revit curves"
        
        # Get the ceiling's sketch (following the article's approach)
        sketch_filter = ElementClassFilter(Sketch)
        sketch_ids = ceiling_element.GetDependentElements(sketch_filter)
        
        if len(sketch_ids) == 0:
            t.RollBack()
            return "Error: Ceiling has no sketch"
        
        sketch = doc.GetElement(sketch_ids[0])
        ceiling_profile = sketch.Profile
        
        # Get the existing ModelLines (editable sketch lines) from the ceiling
        curve_filter = ElementClassFilter(CurveElement)
        dependent_ids = ceiling_element.GetDependentElements(curve_filter)
        
        # Get all ModelLine elements
        model_lines = []
        for elem_id in dependent_ids:
            elem = doc.GetElement(elem_id)
            if isinstance(elem, ModelLine):
                model_lines.append(elem)
        
        if len(model_lines) == 0:
            t.RollBack()
            return "Error: Ceiling has no editable sketch lines"
        
        # Create editable sketch structure matching profile loops with ModelLines
        # Following the article's approach to preserve structure
        editable_sketch = []
        
        for loop in ceiling_profile:
            new_loop = []
            for edge in loop:
                # Find the ModelLine that corresponds to this edge
                for model_line in model_lines:
                    location_curve = model_line.Location
                    if isinstance(location_curve, LocationCurve):
                        current_line = location_curve.Curve
                        
                        # Check if this ModelLine matches this edge
                        # Using approximate comparison for curves
                        if current_line.Intersect(edge) == SetComparisonResult.Equal:
                            new_loop.append(model_line)
                            break
            
            if len(new_loop) > 0:
                editable_sketch.append(new_loop)
        
        if len(editable_sketch) == 0 or len(editable_sketch[0]) == 0:
            t.RollBack()
            return "Error: Could not match ceiling sketch with ModelLines"
        
        # Get the ceiling's outer loop
        outer_loop = editable_sketch[0]
        
        # Revit's minimum curve length (1/32 inch = 0.00260417 feet)
        min_curve_length = 0.003  # Slightly above minimum for safety
        
        # STEP 1: Subdivide the input polyline to match the ceiling's segment count
        # This preserves the polyline's corners while adding intermediate points
        
        target_segment_count = len(outer_loop)
        input_segment_count = len(revit_curves)
        
        if input_segment_count > target_segment_count:
            t.RollBack()
            return "Error: Input polyline has {} segments but ceiling only has {}. Simplify the polyline first.".format(
                input_segment_count, target_segment_count)
        
        # Subdivide each input segment
        subdivided_curves = []
        
        for curve_idx, curve in enumerate(revit_curves):
            # Calculate how many subdivisions this segment needs
            remaining_needed = target_segment_count - len(subdivided_curves)
            remaining_inputs = input_segment_count - curve_idx
            subdivisions = remaining_needed // remaining_inputs
            
            # Subdivide this curve into equal parts
            for i in range(subdivisions):
                t_start = float(i) / subdivisions
                t_end = float(i + 1) / subdivisions
                
                sub_start = curve.Evaluate(t_start, True)
                sub_end = curve.Evaluate(t_end, True)
                sub_segment = Line.CreateBound(sub_start, sub_end)
                
                # Verify minimum length
                if sub_segment.Length < min_curve_length:
                    t.RollBack()
                    return "Error: Subdivided segment too short ({:.6f} ft). Minimum is {:.6f} ft.".format(
                        sub_segment.Length, min_curve_length)
                
                subdivided_curves.append(sub_segment)
        
        # STEP 2: Match ceiling ModelLines to subdivided segments sequentially
        # Find the starting ModelLine closest to the polyline start point
        
        polyline_start = subdivided_curves[0].GetEndPoint(0)
        best_start_idx = 0
        min_dist = float('inf')
        
        for i, model_line in enumerate(outer_loop):
            loc = model_line.Location
            if isinstance(loc, LocationCurve):
                mid = loc.Curve.Evaluate(0.5, True)
                dist = polyline_start.DistanceTo(mid)
                if dist < min_dist:
                    min_dist = dist
                    best_start_idx = i
        
        # Create matched pairs by rotating through ModelLines starting from best match
        matched_pairs = [(outer_loop[(best_start_idx + i) % len(outer_loop)], subdivided_curves[i]) 
                         for i in range(len(subdivided_curves))]
        
        # STEP 3: Assign subdivided segments to ceiling ModelLines
        
        for i, (model_line, new_curve) in enumerate(matched_pairs):
            if new_curve.Length < min_curve_length:
                t.RollBack()
                return "Error: Segment {} too short ({:.6f} ft). Minimum is {:.6f} ft.".format(
                    i, new_curve.Length, min_curve_length)
            
            loc = model_line.Location
            if isinstance(loc, LocationCurve):
                try:
                    loc.Curve = new_curve.Clone()  # Clone to avoid internal linking
                except Exception as ex:
                    t.RollBack()
                    return "Error: Failed to update segment {}: {}".format(i, str(ex))
        
        # Commit the transaction
        try:
            t.Commit()
            return "Success: Updated {} ceiling segments from {} polyline segments".format(
                len(outer_loop), input_segment_count)
        except Exception as ex:
            t.RollBack()
            return "Error: Failed to commit - {}".format(str(ex))
        
    except Exception as ex:
        if t.HasStarted():
            t.RollBack()
        return "Error: {}".format(str(ex))

# Main execution
if not run:
    result = "Not executed"
else:
    # Convert inputs to lists if they aren't already
    ceilings = ceiling if isinstance(ceiling, list) else [ceiling]
    polylines = polyline if isinstance(polyline, list) else [polyline]
    
    # Check if lists have equal length
    if len(ceilings) != len(polylines):
        result = "Error: Ceiling list ({} items) and polyline list ({} items) must have equal length".format(
            len(ceilings), len(polylines))
    else:
        # Process each ceiling-polyline pair
        result = []
        for i, (ceil, poly) in enumerate(zip(ceilings, polylines)):
            msg = update_ceiling_footprint(ceil, poly)
            result.append("[{}] {}".format(i, msg))
        
        # If single input, return single result string
        if len(result) == 1:
            result = result[0].replace("[0] ", "")  # Remove index prefix for single item

# Note: 'result' is automatically assigned to the output parameter in GhPython
# ---------- end match_ceiling_sketch_with_room ----------
panel_3 = Panel(match_ceiling_sketch_with_room.result)

# ==== cluster Cluster
data = ClusterInput()

# ---- group: Tree to main index
data_2 = Data(data)
clean = CleanTree(RemoveNulls=True, RemoveInvalid=True, RemoveEmpty=True, Tree=data_2)
data_3 = Data(clean)

# ---- group: Tree to main index / Gets main index from path
tstat = TreeStatistics(Tree=clean)  # -> Paths, Length, Count
split = TextSplit(Text=tstat.Paths, Separators=";")  # -> simplify(Result)
item = ListItem(List=split, Index=0, Wrap=True)
concat = Concatenate(FragmentA=item, FragmentB="}")
rep = ReplaceText(Text=concat, Find="}}", Replace="}", RecursiveReplace=False)
dup = DuplicateData(Data=rep, Number=simplify(graft(tstat.Length)), Order=True)  # -> flatten(Data)

# ---- group: Tree to main index (continued)
tree = CreateTree(Data=data_3, Path=dup)
data_4 = Data(tree)

# ----
data_5 = ClusterOutput(data_4)
